% Simulink data dictionary M_cfg_type.sldd

Config_M = Simulink.Bus()
  ax0: double
  ay0: double
  az0: double
  ax1: double
  ay1: double
  az1: double
  ax2: double
  ay2: double
  az2: double
  ax3: double
  ay3: double
  az3: double
  bx1: double
  by1: double
  bz1: double
  VR: double
  VT: double
  VO: double
  a: double
  b: double
  c: double
  d: double
  e: double