% Simulink data dictionary N_cfg_type.sldd

Config_N = Simulink.Bus()
  BCL: double
  SD: double
  f1: double
  f2: double
  sigma1sq: double
  sigma2sq: double
  d2: double
  ERP: double
  d0: double
  MDP: double
  VT: double
  VR: double
  Vh: double
  hr: double
  hs: double
  s: double
  j: double
  m: double
  h: double
  f: double
  r: double