% Simulink data dictionary Sensing_cfg_type.sldd

Sensing_cfg = Simulink.Bus()
  amp_Aegm: double
  b_adring: double
  c_va: double
  amp_Vegm: double
  b_vdring: double
  e_Twave: double
  c_av: double
  AV_RC: double
  VA_RC: double
  sense_a: double
  sense_v: double
  amp_AP: double
  amp_VP: double