% Simulink data dictionary Wavefront_type.sldd

Wave_type = Simulink.Bus()
  wave_xi: double
  wave_yi: double
  wave_zi: double
  wave_xj: double
  wave_yj: double
  wave_zj: double
  wave_xir: double
  wave_yir: double
  wave_zir: double
  wave_xjr: double
  wave_yjr: double
  wave_zjr: double