% Simulink data dictionary Heart.sldd
% references N_dd.sldd
% references M_dd.sldd
% references NM_dd.sldd
% references Leads_group.sldd
% references Path_dd.sldd
% references EGM_type.sldd
% references Electrode_dd.sldd
% references Leads_type.sldd
% references M_cfg_type.sldd
% references NM_cfg_type.sldd
% references N_cfg_type.sldd
% references PM_DDD_cfg.sldd
% references PM_DDD_dd.sldd
% references P_cfg_type.sldd
% references Path2Probe_type.sldd
% references Sensing_cfg_type.sldd
% references Sensing_dd.sldd
% references Wavefront_type.sldd
% references cell_out_type.sldd
% references electrode_position.sldd

HeartCfgBus = Simulink.Bus()
  SA: Bus: Config_N
  SA_a: Bus: Config_M
  SA_b: Bus: Config_M
  SA_c: Bus: Config_M
  SA_d: Bus: Config_NM
  CT: Bus: Config_M
  CT_a: Bus: Config_NM
  OS: Bus: Config_NM
  RE: Bus: Config_N
  LNB: Bus: Config_NM
  TC_f: Bus: Config_NM
  CN: Bus: Config_N
  RA_a: Bus: Config_M
  RA: Bus: Config_M
  CS_LA: Bus: Config_NM
  Bach: Bus: Config_M
  LA_a: Bus: Config_M
  LA: Bus: Config_M
  BH: Bus: Config_NM
  His_p: Bus: Config_NM
  His_m: Bus: Config_NM
  His_d: Bus: Config_NM
  RBB_m: Bus: Config_NM
  RBB: Bus: Config_NM
  RBB_a: Bus: Config_NM
  LBB_m: Bus: Config_NM
  LBB: Bus: Config_NM
  LBB_a: Bus: Config_NM
  RVA: Bus: Config_M
  LVA: Bus: Config_M
  SEP_RV_m: Bus: Config_M
  SEP_RV: Bus: Config_M
  RV_m: Bus: Config_NM
  RV: Bus: Config_NM
  SEP_LV: Bus: Config_M
  CS_LV: Bus: Config_M
  SEP_LV_m: Bus: Config_M
  LV_m: Bus: Config_NM
  LV: Bus: Config_NM
  RV_mm: Bus: Config_M
  RVm: Bus: Config_M
  LV_mm: Bus: Config_M
  LVm: Bus: Config_M
  path_1: Bus: Config_Path
  path_2: Bus: Config_Path
  path_3: Bus: Config_Path
  path_4: Bus: Config_Path
  path_5: Bus: Config_Path
  path_6: Bus: Config_Path
  path_7: Bus: Config_Path
  path_8: Bus: Config_Path
  path_9: Bus: Config_Path
  path_10: Bus: Config_Path
  path_11: Bus: Config_Path
  path_12: Bus: Config_Path
  path_13: Bus: Config_Path
  path_14: Bus: Config_Path
  path_15: Bus: Config_Path
  path_16: Bus: Config_Path
  path_17: Bus: Config_Path
  path_18: Bus: Config_Path
  path_19: Bus: Config_Path
  path_20: Bus: Config_Path
  path_21: Bus: Config_Path
  path_22: Bus: Config_Path
  path_23: Bus: Config_Path
  path_24: Bus: Config_Path
  path_25: Bus: Config_Path
  path_26: Bus: Config_Path
  path_27: Bus: Config_Path
  path_28: Bus: Config_Path
  path_29: Bus: Config_Path
  path_30: Bus: Config_Path
  path_31: Bus: Config_Path
  path_32: Bus: Config_Path
  path_33: Bus: Config_Path
  path_34: Bus: Config_Path
  path_35: Bus: Config_Path
  path_36: Bus: Config_Path
  path_37: Bus: Config_Path
  path_38: Bus: Config_Path
  path_39: Bus: Config_Path
  path_40: Bus: Config_Path
  path_41: Bus: Config_Path
  path_42: Bus: Config_Path
  path_43: Bus: Config_Path
  path_44: Bus: Config_Path
  path_45: Bus: Config_Path
  path_46: Bus: Config_Path
  path_47: Bus: Config_Path
  path_48: Bus: Config_Path
  path_49: Bus: Config_Path
  path_50: Bus: Config_Path
  path_51: Bus: Config_Path
  path_52: Bus: Config_Path
  path_53: Bus: Config_Path
  path_54: Bus: Config_Path
  Leads: Bus: Lead_group