% Simulink data dictionary Heart_3D.sldd
% references N_dd.sldd
% references M_dd.sldd
% references NM_dd.sldd
% references Path_dd.sldd
% references Sensing_dd.sldd
% references Dipole_cfg_type.sldd
% references Wavefront_type.sldd
% references Path2Probe_type.sldd
% references PM_DDD_dd.sldd
% references Leads_3D.sldd
% references SharedConfigData.sldd

HeartCfgBus = Simulink.Bus()
  SA: Bus: Config_N
  SA_a: Bus: Config_M
  SA_b: Bus: Config_M
  SA_c: Bus: Config_M
  SA_d: Bus: Config_NM
  CT: Bus: Config_M
  CT_a: Bus: Config_NM
  OS: Bus: Config_NM
  RE: Bus: Config_N
  LNB: Bus: Config_NM
  TC_f: Bus: Config_NM
  CN: Bus: Config_N
  RA_a: Bus: Config_M
  RA: Bus: Config_M
  CS_LA: Bus: Config_NM
  Bach: Bus: Config_M
  LA_a: Bus: Config_M
  LA: Bus: Config_M
  BH: Bus: Config_NM
  His_p: Bus: Config_NM
  His_m: Bus: Config_NM
  His_d: Bus: Config_NM
  RBB_m: Bus: Config_NM
  RBB: Bus: Config_NM
  RBB_a: Bus: Config_NM
  LBB_m: Bus: Config_NM
  LBB: Bus: Config_NM
  LBB_a: Bus: Config_NM
  RVA: Bus: Config_M
  LVA: Bus: Config_M
  SEP_RV_m: Bus: Config_M
  SEP_RV: Bus: Config_M
  RV_m: Bus: Config_NM
  RV: Bus: Config_NM
  SEP_LV: Bus: Config_M
  CS_LV: Bus: Config_M
  SEP_LV_m: Bus: Config_M
  LV_m: Bus: Config_NM
  LV: Bus: Config_NM
  RV_mm: Bus: Config_M
  RVm: Bus: Config_M
  LV_mm: Bus: Config_M
  LVm: Bus: Config_M
  path_1: Bus: Config_Path
  path_2: Bus: Config_Path
  path_3: Bus: Config_Path
  path_4: Bus: Config_Path
  path_5: Bus: Config_Path
  path_6: Bus: Config_Path
  path_7: Bus: Config_Path
  path_8: Bus: Config_Path
  path_9: Bus: Config_Path
  path_10: Bus: Config_Path
  path_11: Bus: Config_Path
  path_12: Bus: Config_Path
  path_13: Bus: Config_Path
  path_14: Bus: Config_Path
  path_15: Bus: Config_Path
  path_16: Bus: Config_Path
  path_17: Bus: Config_Path
  path_18: Bus: Config_Path
  path_19: Bus: Config_Path
  path_20: Bus: Config_Path
  path_21: Bus: Config_Path
  path_22: Bus: Config_Path
  path_23: Bus: Config_Path
  path_24: Bus: Config_Path
  path_25: Bus: Config_Path
  path_26: Bus: Config_Path
  path_27: Bus: Config_Path
  path_28: Bus: Config_Path
  path_29: Bus: Config_Path
  path_30: Bus: Config_Path
  path_31: Bus: Config_Path
  path_32: Bus: Config_Path
  path_33: Bus: Config_Path
  path_34: Bus: Config_Path
  path_35: Bus: Config_Path
  path_36: Bus: Config_Path
  path_37: Bus: Config_Path
  path_38: Bus: Config_Path
  path_39: Bus: Config_Path
  path_40: Bus: Config_Path
  path_41: Bus: Config_Path
  path_42: Bus: Config_Path
  path_43: Bus: Config_Path
  path_44: Bus: Config_Path
  path_45: Bus: Config_Path
  path_46: Bus: Config_Path
  path_47: Bus: Config_Path
  path_48: Bus: Config_Path
  path_49: Bus: Config_Path
  path_50: Bus: Config_Path
  path_51: Bus: Config_Path
  path_52: Bus: Config_Path
  path_53: Bus: Config_Path
  path_54: Bus: Config_Path
  dipole_1: Bus: Config_Dipole
  dipole_2: Bus: Config_Dipole
  dipole_3: Bus: Config_Dipole
  dipole_4: Bus: Config_Dipole
  dipole_5: Bus: Config_Dipole
  dipole_6: Bus: Config_Dipole
  dipole_7: Bus: Config_Dipole
  dipole_8: Bus: Config_Dipole
  dipole_9: Bus: Config_Dipole
  dipole_10: Bus: Config_Dipole
  dipole_11: Bus: Config_Dipole
  dipole_12: Bus: Config_Dipole
  dipole_13: Bus: Config_Dipole
  dipole_14: Bus: Config_Dipole
  dipole_15: Bus: Config_Dipole
  dipole_16: Bus: Config_Dipole
  dipole_17: Bus: Config_Dipole
  dipole_18: Bus: Config_Dipole
  dipole_19: Bus: Config_Dipole
  dipole_20: Bus: Config_Dipole
  dipole_21: Bus: Config_Dipole
  dipole_22: Bus: Config_Dipole
  dipole_23: Bus: Config_Dipole
  dipole_24: Bus: Config_Dipole
  dipole_25: Bus: Config_Dipole
  dipole_26: Bus: Config_Dipole
  dipole_27: Bus: Config_Dipole
  dipole_28: Bus: Config_Dipole
  dipole_29: Bus: Config_Dipole
  dipole_30: Bus: Config_Dipole
  dipole_31: Bus: Config_Dipole
  dipole_32: Bus: Config_Dipole
  dipole_33: Bus: Config_Dipole
  dipole_34: Bus: Config_Dipole
  dipole_35: Bus: Config_Dipole
  dipole_36: Bus: Config_Dipole
  dipole_37: Bus: Config_Dipole
  dipole_38: Bus: Config_Dipole
  dipole_39: Bus: Config_Dipole
  dipole_40: Bus: Config_Dipole
  dipole_41: Bus: Config_Dipole
  dipole_42: Bus: Config_Dipole
  dipole_43: Bus: Config_Dipole
  dipole_44: Bus: Config_Dipole
  dipole_45: Bus: Config_Dipole
  dipole_46: Bus: Config_Dipole
  dipole_47: Bus: Config_Dipole
  dipole_48: Bus: Config_Dipole
  dipole_49: Bus: Config_Dipole
  dipole_50: Bus: Config_Dipole
  dipole_51: Bus: Config_Dipole
  dipole_52: Bus: Config_Dipole
  dipole_53: Bus: Config_Dipole
  dipole_54: Bus: Config_Dipole

HeartCfg = struct(
  SA=struct(
    BCL=0.814,
    SD=0.002,
    f1=0.1,
    f2=0.25,
    sigma1sq=0.0035,
    sigma2sq=0.007,
    d2=1281,
    ERP=0.1615,
    d0=-773.2,
    MDP=-85.3,
    VT=23.81,
    VR=47.94,
    Vh=-4,
    hr=0.1,
    hs=35,
    s=5,
    j=0,
    m=1,
    h=0.2,
    f=0.1,
    r=0.5),
  SA_a=struct(
    ax0=-103.7652,
    ay0=-31.4719,
    az0=-19.86729,
    ax1=-23.6,
    ay1=-45.5,
    az1=-12.9,
    ax2=-6.9,
    ay2=75.9,
    az2=6826.5,
    ax3=-271.1289,
    ay3=13.1311,
    az3=0.2024544,
    bx1=777.2,
    by1=58.9,
    bz1=276.6,
    VR=40.57625,
    VT=44.5,
    VO=112.4476,
    a=0.29,
    b=62.89,
    c=0.7,
    d=10.99,
    e=0.04),
  SA_b=struct(
    ax0=-103.7652,
    ay0=-31.4719,
    az0=-19.86729,
    ax1=-23.6,
    ay1=-45.5,
    az1=-12.9,
    ax2=-6.9,
    ay2=75.9,
    az2=6826.5,
    ax3=-271.1289,
    ay3=13.1311,
    az3=0.2024544,
    bx1=777.2,
    by1=58.9,
    bz1=276.6,
    VR=40.57625,
    VT=44.5,
    VO=112.4476,
    a=0.29,
    b=62.89,
    c=0.7,
    d=10.99,
    e=0.04),
  SA_c=struct(
    ax0=-103.7652,
    ay0=-31.4719,
    az0=-19.86729,
    ax1=-23.6,
    ay1=-45.5,
    az1=-12.9,
    ax2=-6.9,
    ay2=75.9,
    az2=6826.5,
    ax3=-271.1289,
    ay3=13.1311,
    az3=0.2024544,
    bx1=777.2,
    by1=58.9,
    bz1=276.6,
    VR=40.57625,
    VT=44.5,
    VO=112.4476,
    a=0.29,
    b=62.89,
    c=0.7,
    d=10.99,
    e=0.04),
  SA_d=struct(
    cfg_N=struct(
      BCL=2.1,
      SD=0.002,
      f1=0.1,
      f2=0.25,
      sigma1sq=0.0035,
      sigma2sq=0.007,
      d2=3340,
      ERP=0.108,
      d0=-944.8,
      MDP=-74.65,
      VT=25.05,
      VR=41.25,
      Vh=-15,
      hr=0.1,
      hs=35,
      s=5,
      j=2,
      m=1,
      h=0,
      f=0,
      r=0.5),
    cfg_M=struct(
      ax0=-103.7652,
      ay0=-31.4719,
      az0=-19.86729,
      ax1=-23.6,
      ay1=-45.5,
      az1=-12.9,
      ax2=-6.9,
      ay2=75.9,
      az2=6826.5,
      ax3=-271.1289,
      ay3=13.1311,
      az3=0.2024544,
      bx1=777.2,
      by1=58.9,
      bz1=276.6,
      VR=40.57625,
      VT=44.5,
      VO=112.4476,
      a=0.29,
      b=62.89,
      c=0.7,
      d=10.99,
      e=0.04)),
  CT=struct(
    ax0=-103.7652,
    ay0=-31.4719,
    az0=-19.86729,
    ax1=-23.6,
    ay1=-45.5,
    az1=-12.9,
    ax2=-6.9,
    ay2=75.9,
    az2=6826.5,
    ax3=-271.1289,
    ay3=13.1311,
    az3=0.2024544,
    bx1=777.2,
    by1=58.9,
    bz1=276.6,
    VR=40.57625,
    VT=44.5,
    VO=112.4476,
    a=0.29,
    b=62.89,
    c=0.7,
    d=10.99,
    e=0.04),
  CT_a=struct(
    cfg_N=struct(
      BCL=2.1,
      SD=0.002,
      f1=0.1,
      f2=0.25,
      sigma1sq=0.0035,
      sigma2sq=0.007,
      d2=3340,
      ERP=0.108,
      d0=-944.8,
      MDP=-74.65,
      VT=25.05,
      VR=41.25,
      Vh=-15,
      hr=0.1,
      hs=35,
      s=5,
      j=2,
      m=1,
      h=0,
      f=0,
      r=0.5),
    cfg_M=struct(
      ax0=-103.7652,
      ay0=-31.4719,
      az0=-19.86729,
      ax1=-23.6,
      ay1=-45.5,
      az1=-12.9,
      ax2=-6.9,
      ay2=75.9,
      az2=6826.5,
      ax3=-271.1289,
      ay3=13.1311,
      az3=0.2024544,
      bx1=777.2,
      by1=58.9,
      bz1=276.6,
      VR=40.57625,
      VT=44.5,
      VO=112.4476,
      a=0.29,
      b=62.89,
      c=0.7,
      d=10.99,
      e=0.04)),
  OS=struct(
    cfg_N=struct(
      BCL=2.1,
      SD=0.002,
      f1=0.1,
      f2=0.25,
      sigma1sq=0.0035,
      sigma2sq=0.007,
      d2=3340,
      ERP=0.108,
      d0=-944.8,
      MDP=-74.65,
      VT=25.05,
      VR=41.25,
      Vh=-15,
      hr=0.1,
      hs=35,
      s=5,
      j=2,
      m=1,
      h=0,
      f=0,
      r=0.5),
    cfg_M=struct(
      ax0=-103.7652,
      ay0=-31.4719,
      az0=-19.86729,
      ax1=-23.6,
      ay1=-45.5,
      az1=-12.9,
      ax2=-6.9,
      ay2=75.9,
      az2=6826.5,
      ax3=-271.1289,
      ay3=13.1311,
      az3=0.2024544,
      bx1=777.2,
      by1=58.9,
      bz1=276.6,
      VR=40.57625,
      VT=44.5,
      VO=112.4476,
      a=0.29,
      b=62.89,
      c=0.7,
      d=10.99,
      e=0.04)),
  RE=struct(
    BCL=2.1,
    SD=0.002,
    f1=0.1,
    f2=0.25,
    sigma1sq=0.0035,
    sigma2sq=0.007,
    d2=3340,
    ERP=0.278,
    d0=-944.8,
    MDP=-74.65,
    VT=25.05,
    VR=41.25,
    Vh=-4,
    hr=0.1,
    hs=35,
    s=5,
    j=0,
    m=1,
    h=0.2,
    f=0.1,
    r=0.5),
  LNB=struct(
    cfg_N=struct(
      BCL=2.3,
      SD=0.002,
      f1=0.1,
      f2=0.25,
      sigma1sq=0.0035,
      sigma2sq=0.007,
      d2=3340,
      ERP=0.108,
      d0=-944.8,
      MDP=-74.65,
      VT=25.05,
      VR=41.25,
      Vh=-15,
      hr=0.1,
      hs=35,
      s=5,
      j=2,
      m=1,
      h=0,
      f=0,
      r=0.5),
    cfg_M=struct(
      ax0=-8.7,
      ay0=-190.9,
      az0=-190.4,
      ax1=-23.6,
      ay1=-45.5,
      az1=-12.9,
      ax2=-6.9,
      ay2=75.9,
      az2=6826.5,
      ax3=-33.2,
      ay3=14.62,
      az3=2,
      bx1=777.2,
      by1=58.9,
      bz1=276.6,
      VR=30,
      VT=44.5,
      VO=131.1,
      a=0.29,
      b=62.89,
      c=0.7,
      d=10.99,
      e=0.04)),
  TC_f=struct(
    cfg_N=struct(
      BCL=2.1,
      SD=0.002,
      f1=0.1,
      f2=0.25,
      sigma1sq=0.0035,
      sigma2sq=0.007,
      d2=3340,
      ERP=0.108,
      d0=-944.8,
      MDP=-74.65,
      VT=25.05,
      VR=41.25,
      Vh=-15,
      hr=0.1,
      hs=35,
      s=5,
      j=2,
      m=1,
      h=0,
      f=0,
      r=0.5),
    cfg_M=struct(
      ax0=-103.7652,
      ay0=-31.4719,
      az0=-19.86729,
      ax1=-23.6,
      ay1=-45.5,
      az1=-12.9,
      ax2=-6.9,
      ay2=75.9,
      az2=6826.5,
      ax3=-271.1289,
      ay3=8.72,
      az3=0.2024544,
      bx1=777.2,
      by1=58.9,
      bz1=276.6,
      VR=40.57625,
      VT=44.5,
      VO=112.4476,
      a=0.29,
      b=62.89,
      c=0.7,
      d=10.99,
      e=0.04)),
  CN=struct(
    BCL=1.5,
    SD=0.002,
    f1=0.1,
    f2=0.25,
    sigma1sq=0.0035,
    sigma2sq=0.007,
    d2=3340,
    ERP=0.214,
    d0=-944.8,
    MDP=-74.65,
    VT=25.05,
    VR=41.25,
    Vh=-4,
    hr=0.1,
    hs=35,
    s=5,
    j=0,
    m=1,
    h=0.2,
    f=0.8,
    r=0.5),
  RA_a=struct(
    ax0=-103.7652,
    ay0=-31.4719,
    az0=-19.86729,
    ax1=-23.6,
    ay1=-45.5,
    az1=-12.9,
    ax2=-6.9,
    ay2=75.9,
    az2=6826.5,
    ax3=-271.1289,
    ay3=13.1311,
    az3=0.2024544,
    bx1=777.2,
    by1=58.9,
    bz1=276.6,
    VR=40.57625,
    VT=44.5,
    VO=112.4476,
    a=0.29,
    b=62.89,
    c=0.7,
    d=10.99,
    e=0.04),
  RA=struct(
    ax0=-103.7652,
    ay0=-31.4719,
    az0=-19.86729,
    ax1=-23.6,
    ay1=-45.5,
    az1=-12.9,
    ax2=-6.9,
    ay2=75.9,
    az2=6826.5,
    ax3=-271.1289,
    ay3=13.1311,
    az3=0.2024544,
    bx1=777.2,
    by1=58.9,
    bz1=276.6,
    VR=40.57625,
    VT=44.5,
    VO=112.4476,
    a=0.29,
    b=62.89,
    c=0.7,
    d=10.99,
    e=0.04),
  CS_LA=struct(
    cfg_N=struct(
      BCL=2.2,
      SD=0.002,
      f1=0.1,
      f2=0.25,
      sigma1sq=0.0035,
      sigma2sq=0.007,
      d2=3340,
      ERP=0.108,
      d0=-944.8,
      MDP=-74.65,
      VT=25.05,
      VR=41.25,
      Vh=-15,
      hr=0.1,
      hs=35,
      s=5,
      j=2,
      m=1,
      h=0,
      f=0,
      r=0.5),
    cfg_M=struct(
      ax0=-103.7652,
      ay0=-31.4719,
      az0=-19.86729,
      ax1=-23.6,
      ay1=-45.5,
      az1=-12.9,
      ax2=-6.9,
      ay2=75.9,
      az2=6826.5,
      ax3=-271.1289,
      ay3=13.1311,
      az3=0.2024544,
      bx1=777.2,
      by1=58.9,
      bz1=276.6,
      VR=40.57625,
      VT=44.5,
      VO=112.4476,
      a=0.29,
      b=62.89,
      c=0.7,
      d=10.99,
      e=0.04)),
  Bach=struct(
    ax0=-103.7652,
    ay0=-31.4719,
    az0=-19.86729,
    ax1=-23.6,
    ay1=-45.5,
    az1=-12.9,
    ax2=-6.9,
    ay2=75.9,
    az2=6826.5,
    ax3=-271.1289,
    ay3=13.1311,
    az3=0.2024544,
    bx1=777.2,
    by1=58.9,
    bz1=276.6,
    VR=40.57625,
    VT=44.5,
    VO=112.4476,
    a=0.29,
    b=62.89,
    c=0.7,
    d=10.99,
    e=0.04),
  LA_a=struct(
    ax0=-103.7652,
    ay0=-31.4719,
    az0=-19.86729,
    ax1=-23.6,
    ay1=-45.5,
    az1=-12.9,
    ax2=-6.9,
    ay2=75.9,
    az2=6826.5,
    ax3=-271.1289,
    ay3=13.1311,
    az3=0.2024544,
    bx1=777.2,
    by1=58.9,
    bz1=276.6,
    VR=40.57625,
    VT=44.5,
    VO=112.4476,
    a=0.29,
    b=62.89,
    c=0.7,
    d=10.99,
    e=0.04),
  LA=struct(
    ax0=-103.7652,
    ay0=-31.4719,
    az0=-19.86729,
    ax1=-23.6,
    ay1=-45.5,
    az1=-12.9,
    ax2=-6.9,
    ay2=75.9,
    az2=6826.5,
    ax3=-271.1289,
    ay3=13.1311,
    az3=0.2024544,
    bx1=777.2,
    by1=58.9,
    bz1=276.6,
    VR=40.57625,
    VT=44.5,
    VO=112.4476,
    a=0.29,
    b=62.89,
    c=0.7,
    d=10.99,
    e=0.04),
  BH=struct(
    cfg_N=struct(
      BCL=2.3,
      SD=0.002,
      f1=0.1,
      f2=0.25,
      sigma1sq=0.0035,
      sigma2sq=0.007,
      d2=3340,
      ERP=0.108,
      d0=-944.8,
      MDP=-74.65,
      VT=25.05,
      VR=41.25,
      Vh=-15,
      hr=0.1,
      hs=35,
      s=5,
      j=2,
      m=1,
      h=0,
      f=0,
      r=0.5),
    cfg_M=struct(
      ax0=-8.7,
      ay0=-190.9,
      az0=-190.4,
      ax1=-23.6,
      ay1=-45.5,
      az1=-12.9,
      ax2=-6.9,
      ay2=75.9,
      az2=6826.5,
      ax3=-33.2,
      ay3=13.94,
      az3=2,
      bx1=777.2,
      by1=58.9,
      bz1=276.6,
      VR=30,
      VT=44.5,
      VO=131.1,
      a=0.29,
      b=62.89,
      c=0.7,
      d=10.99,
      e=0.04)),
  His_p=struct(
    cfg_N=struct(
      BCL=2.3,
      SD=0.002,
      f1=0.1,
      f2=0.25,
      sigma1sq=0.0035,
      sigma2sq=0.007,
      d2=3340,
      ERP=0.108,
      d0=-944.8,
      MDP=-74.65,
      VT=25.05,
      VR=41.25,
      Vh=-15,
      hr=0.1,
      hs=35,
      s=5,
      j=2,
      m=1,
      h=0,
      f=0,
      r=0.5),
    cfg_M=struct(
      ax0=-8.7,
      ay0=-190.9,
      az0=-190.4,
      ax1=-23.6,
      ay1=-45.5,
      az1=-12.9,
      ax2=-6.9,
      ay2=75.9,
      az2=6826.5,
      ax3=-33.2,
      ay3=11.06,
      az3=2,
      bx1=777.2,
      by1=58.9,
      bz1=276.6,
      VR=30,
      VT=44.5,
      VO=131.1,
      a=0.29,
      b=62.89,
      c=0.7,
      d=10.99,
      e=0.04)),
  His_m=struct(
    cfg_N=struct(
      BCL=2.3,
      SD=0.002,
      f1=0.1,
      f2=0.25,
      sigma1sq=0.0035,
      sigma2sq=0.007,
      d2=3340,
      ERP=0.108,
      d0=-944.8,
      MDP=-74.65,
      VT=25.05,
      VR=41.25,
      Vh=-15,
      hr=0.1,
      hs=35,
      s=5,
      j=2,
      m=1,
      h=0,
      f=0,
      r=0.5),
    cfg_M=struct(
      ax0=-8.7,
      ay0=-190.9,
      az0=-190.4,
      ax1=-23.6,
      ay1=-45.5,
      az1=-12.9,
      ax2=-6.9,
      ay2=75.9,
      az2=6826.5,
      ax3=-33.2,
      ay3=11.14,
      az3=2,
      bx1=777.2,
      by1=58.9,
      bz1=276.6,
      VR=30,
      VT=44.5,
      VO=131.1,
      a=0.29,
      b=62.89,
      c=0.7,
      d=10.99,
      e=0.04)),
  His_d=struct(
    cfg_N=struct(
      BCL=2.3,
      SD=0.002,
      f1=0.1,
      f2=0.25,
      sigma1sq=0.0035,
      sigma2sq=0.007,
      d2=3340,
      ERP=0.108,
      d0=-944.8,
      MDP=-74.65,
      VT=25.05,
      VR=41.25,
      Vh=-15,
      hr=0.1,
      hs=35,
      s=5,
      j=2,
      m=1,
      h=0,
      f=0,
      r=0.5),
    cfg_M=struct(
      ax0=-8.7,
      ay0=-190.9,
      az0=-190.4,
      ax1=-23.6,
      ay1=-45.5,
      az1=-12.9,
      ax2=-6.9,
      ay2=75.9,
      az2=6826.5,
      ax3=-33.2,
      ay3=11.36,
      az3=2,
      bx1=777.2,
      by1=58.9,
      bz1=276.6,
      VR=30,
      VT=44.5,
      VO=131.1,
      a=0.29,
      b=62.89,
      c=0.7,
      d=10.99,
      e=0.04)),
  RBB_m=struct(
    cfg_N=struct(
      BCL=2.3,
      SD=0.002,
      f1=0.1,
      f2=0.25,
      sigma1sq=0.0035,
      sigma2sq=0.007,
      d2=3340,
      ERP=0.108,
      d0=-944.8,
      MDP=-74.65,
      VT=25.05,
      VR=41.25,
      Vh=-25,
      hr=0.1,
      hs=35,
      s=4,
      j=2,
      m=1,
      h=0,
      f=0,
      r=0.5),
    cfg_M=struct(
      ax0=-8.7,
      ay0=-190.9,
      az0=-190.4,
      ax1=-23.6,
      ay1=-45.5,
      az1=-12.9,
      ax2=-6.9,
      ay2=75.9,
      az2=6826.5,
      ax3=-33.2,
      ay3=11.66,
      az3=2,
      bx1=777.2,
      by1=58.9,
      bz1=276.6,
      VR=30,
      VT=44.5,
      VO=131.1,
      a=0.29,
      b=62.89,
      c=0.7,
      d=10.99,
      e=0.04)),
  RBB=struct(
    cfg_N=struct(
      BCL=2.3,
      SD=0.002,
      f1=0.1,
      f2=0.25,
      sigma1sq=0.0035,
      sigma2sq=0.007,
      d2=3340,
      ERP=0.108,
      d0=-944.8,
      MDP=-74.65,
      VT=25.05,
      VR=41.25,
      Vh=-25,
      hr=0.1,
      hs=35,
      s=4,
      j=2,
      m=1,
      h=0,
      f=0,
      r=0.5),
    cfg_M=struct(
      ax0=-8.7,
      ay0=-190.9,
      az0=-190.4,
      ax1=-23.6,
      ay1=-45.5,
      az1=-12.9,
      ax2=-6.9,
      ay2=75.9,
      az2=6826.5,
      ax3=-33.2,
      ay3=12.6,
      az3=2,
      bx1=777.2,
      by1=58.9,
      bz1=276.6,
      VR=30,
      VT=44.5,
      VO=131.1,
      a=0.29,
      b=62.89,
      c=0.7,
      d=10.99,
      e=0.04)),
  RBB_a=struct(
    cfg_N=struct(
      BCL=2.3,
      SD=0.002,
      f1=0.1,
      f2=0.25,
      sigma1sq=0.0035,
      sigma2sq=0.007,
      d2=3340,
      ERP=0.108,
      d0=-944.8,
      MDP=-74.65,
      VT=25.05,
      VR=41.25,
      Vh=-25,
      hr=0.1,
      hs=35,
      s=4,
      j=2,
      m=1,
      h=0,
      f=0,
      r=0.5),
    cfg_M=struct(
      ax0=-8.7,
      ay0=-190.9,
      az0=-190.4,
      ax1=-23.6,
      ay1=-45.5,
      az1=-12.9,
      ax2=-6.9,
      ay2=75.9,
      az2=6826.5,
      ax3=-33.2,
      ay3=12.98,
      az3=2,
      bx1=777.2,
      by1=58.9,
      bz1=276.6,
      VR=30,
      VT=44.5,
      VO=131.1,
      a=0.29,
      b=62.89,
      c=0.7,
      d=10.99,
      e=0.04)),
  LBB_m=struct(
    cfg_N=struct(
      BCL=2.3,
      SD=0.002,
      f1=0.1,
      f2=0.25,
      sigma1sq=0.0035,
      sigma2sq=0.007,
      d2=3340,
      ERP=0.108,
      d0=-944.8,
      MDP=-74.65,
      VT=25.05,
      VR=41.25,
      Vh=-25,
      hr=0.1,
      hs=35,
      s=4,
      j=2,
      m=1,
      h=0,
      f=0,
      r=0.5),
    cfg_M=struct(
      ax0=-8.7,
      ay0=-190.9,
      az0=-190.4,
      ax1=-23.6,
      ay1=-45.5,
      az1=-12.9,
      ax2=-6.9,
      ay2=75.9,
      az2=6826.5,
      ax3=-33.2,
      ay3=11.92,
      az3=2,
      bx1=777.2,
      by1=58.9,
      bz1=276.6,
      VR=30,
      VT=44.5,
      VO=131.1,
      a=0.29,
      b=62.89,
      c=0.7,
      d=10.99,
      e=0.04)),
  LBB=struct(
    cfg_N=struct(
      BCL=2.3,
      SD=0.002,
      f1=0.1,
      f2=0.25,
      sigma1sq=0.0035,
      sigma2sq=0.007,
      d2=3340,
      ERP=0.108,
      d0=-944.8,
      MDP=-74.65,
      VT=25.05,
      VR=41.25,
      Vh=-25,
      hr=0.1,
      hs=35,
      s=4,
      j=2,
      m=1,
      h=0,
      f=0,
      r=0.5),
    cfg_M=struct(
      ax0=-8.7,
      ay0=-190.9,
      az0=-190.4,
      ax1=-23.6,
      ay1=-45.5,
      az1=-12.9,
      ax2=-6.9,
      ay2=75.9,
      az2=6826.5,
      ax3=-33.2,
      ay3=12.92,
      az3=2,
      bx1=777.2,
      by1=58.9,
      bz1=276.6,
      VR=30,
      VT=44.5,
      VO=131.1,
      a=0.29,
      b=62.89,
      c=0.7,
      d=10.99,
      e=0.04)),
  LBB_a=struct(
    cfg_N=struct(
      BCL=2.3,
      SD=0.002,
      f1=0.1,
      f2=0.25,
      sigma1sq=0.0035,
      sigma2sq=0.007,
      d2=3340,
      ERP=0.108,
      d0=-944.8,
      MDP=-74.65,
      VT=25.05,
      VR=41.25,
      Vh=-25,
      hr=0.1,
      hs=35,
      s=4,
      j=2,
      m=1,
      h=0,
      f=0,
      r=0.5),
    cfg_M=struct(
      ax0=-8.7,
      ay0=-190.9,
      az0=-190.4,
      ax1=-23.6,
      ay1=-45.5,
      az1=-12.9,
      ax2=-6.9,
      ay2=75.9,
      az2=6826.5,
      ax3=-33.2,
      ay3=13.34,
      az3=2,
      bx1=777.2,
      by1=58.9,
      bz1=276.6,
      VR=30,
      VT=44.5,
      VO=131.1,
      a=0.29,
      b=62.89,
      c=0.7,
      d=10.99,
      e=0.04)),
  RVA=struct(
    ax0=-8.7,
    ay0=-190.9,
    az0=-190.4,
    ax1=-23.6,
    ay1=-45.5,
    az1=-12.9,
    ax2=-6.9,
    ay2=75.9,
    az2=6826.5,
    ax3=-17.80971,
    ay3=13.97137,
    az3=1.783211,
    bx1=777.2,
    by1=58.9,
    bz1=276.6,
    VR=30,
    VT=44.5,
    VO=122.8702,
    a=0.29,
    b=62.89,
    c=0.7,
    d=10.99,
    e=0.04),
  LVA=struct(
    ax0=-8.7,
    ay0=-190.9,
    az0=-190.4,
    ax1=-23.6,
    ay1=-45.5,
    az1=-12.9,
    ax2=-6.9,
    ay2=75.9,
    az2=6826.5,
    ax3=-17.80971,
    ay3=13.97137,
    az3=1.783211,
    bx1=777.2,
    by1=58.9,
    bz1=276.6,
    VR=30,
    VT=44.5,
    VO=122.8702,
    a=0.29,
    b=62.89,
    c=0.7,
    d=10.99,
    e=0.04),
  SEP_RV_m=struct(
    ax0=-8.7,
    ay0=-190.9,
    az0=-190.4,
    ax1=-23.6,
    ay1=-45.5,
    az1=-12.9,
    ax2=-6.9,
    ay2=75.9,
    az2=6826.5,
    ax3=-17.80971,
    ay3=13.97137,
    az3=1.783211,
    bx1=777.2,
    by1=58.9,
    bz1=276.6,
    VR=30,
    VT=44.5,
    VO=122.8702,
    a=0.29,
    b=62.89,
    c=0.7,
    d=10.99,
    e=0.04),
  SEP_RV=struct(
    ax0=-8.7,
    ay0=-190.9,
    az0=-190.4,
    ax1=-23.6,
    ay1=-45.5,
    az1=-12.9,
    ax2=-6.9,
    ay2=75.9,
    az2=6826.5,
    ax3=-17.80971,
    ay3=13.97137,
    az3=1.783211,
    bx1=777.2,
    by1=58.9,
    bz1=276.6,
    VR=30,
    VT=44.5,
    VO=122.8702,
    a=0.29,
    b=62.89,
    c=0.7,
    d=10.99,
    e=0.04),
  RV_m=struct(
    cfg_N=struct(
      BCL=2.3,
      SD=0.002,
      f1=0.1,
      f2=0.25,
      sigma1sq=0.0035,
      sigma2sq=0.007,
      d2=3340,
      ERP=0.108,
      d0=-944.8,
      MDP=-74.65,
      VT=25.05,
      VR=41.25,
      Vh=-25,
      hr=0.1,
      hs=35,
      s=4,
      j=2,
      m=1,
      h=0,
      f=0,
      r=0.5),
    cfg_M=struct(
      ax0=-8.7,
      ay0=-190.9,
      az0=-190.4,
      ax1=-23.6,
      ay1=-45.5,
      az1=-12.9,
      ax2=-6.9,
      ay2=75.9,
      az2=6826.5,
      ax3=-33.2,
      ay3=13.94,
      az3=2,
      bx1=777.2,
      by1=58.9,
      bz1=276.6,
      VR=30,
      VT=44.5,
      VO=131.1,
      a=0.29,
      b=62.89,
      c=0.7,
      d=10.99,
      e=0.04)),
  RV=struct(
    cfg_N=struct(
      BCL=2.3,
      SD=0.002,
      f1=0.1,
      f2=0.25,
      sigma1sq=0.0035,
      sigma2sq=0.007,
      d2=3340,
      ERP=0.108,
      d0=-944.8,
      MDP=-74.65,
      VT=25.05,
      VR=41.25,
      Vh=-25,
      hr=0.1,
      hs=35,
      s=4,
      j=2,
      m=1,
      h=0,
      f=0,
      r=0.5),
    cfg_M=struct(
      ax0=-8.7,
      ay0=-190.9,
      az0=-190.4,
      ax1=-23.6,
      ay1=-45.5,
      az1=-12.9,
      ax2=-6.9,
      ay2=75.9,
      az2=6826.5,
      ax3=-33.2,
      ay3=13.94,
      az3=2,
      bx1=777.2,
      by1=58.9,
      bz1=276.6,
      VR=30,
      VT=44.5,
      VO=131.1,
      a=0.29,
      b=62.89,
      c=0.7,
      d=10.99,
      e=0.04)),
  SEP_LV=struct(
    ax0=-8.7,
    ay0=-190.9,
    az0=-190.4,
    ax1=-23.6,
    ay1=-45.5,
    az1=-12.9,
    ax2=-6.9,
    ay2=75.9,
    az2=6826.5,
    ax3=-17.80971,
    ay3=13.97137,
    az3=1.783211,
    bx1=777.2,
    by1=58.9,
    bz1=276.6,
    VR=30,
    VT=44.5,
    VO=122.8702,
    a=0.29,
    b=62.89,
    c=0.7,
    d=10.99,
    e=0.04),
  CS_LV=struct(
    ax0=-8.7,
    ay0=-190.9,
    az0=-190.4,
    ax1=-23.6,
    ay1=-45.5,
    az1=-12.9,
    ax2=-6.9,
    ay2=75.9,
    az2=6826.5,
    ax3=-17.80971,
    ay3=13.97137,
    az3=1.783211,
    bx1=777.2,
    by1=58.9,
    bz1=276.6,
    VR=30,
    VT=44.5,
    VO=122.8702,
    a=0.29,
    b=62.89,
    c=0.7,
    d=10.99,
    e=0.04),
  SEP_LV_m=struct(
    ax0=-8.7,
    ay0=-190.9,
    az0=-190.4,
    ax1=-23.6,
    ay1=-45.5,
    az1=-12.9,
    ax2=-6.9,
    ay2=75.9,
    az2=6826.5,
    ax3=-17.80971,
    ay3=13.97137,
    az3=1.783211,
    bx1=777.2,
    by1=58.9,
    bz1=276.6,
    VR=30,
    VT=44.5,
    VO=122.8702,
    a=0.29,
    b=62.89,
    c=0.7,
    d=10.99,
    e=0.04),
  LV_m=struct(
    cfg_N=struct(
      BCL=2.3,
      SD=0.002,
      f1=0.1,
      f2=0.25,
      sigma1sq=0.0035,
      sigma2sq=0.007,
      d2=3340,
      ERP=0.108,
      d0=-944.8,
      MDP=-74.65,
      VT=25.05,
      VR=41.25,
      Vh=-25,
      hr=0.1,
      hs=35,
      s=4,
      j=2,
      m=1,
      h=0,
      f=0,
      r=0.5),
    cfg_M=struct(
      ax0=-8.7,
      ay0=-190.9,
      az0=-190.4,
      ax1=-23.6,
      ay1=-45.5,
      az1=-12.9,
      ax2=-6.9,
      ay2=75.9,
      az2=6826.5,
      ax3=-33.2,
      ay3=14.36,
      az3=2,
      bx1=777.2,
      by1=58.9,
      bz1=276.6,
      VR=30,
      VT=44.5,
      VO=131.1,
      a=0.29,
      b=62.89,
      c=0.7,
      d=10.99,
      e=0.04)),
  LV=struct(
    cfg_N=struct(
      BCL=2.3,
      SD=0.002,
      f1=0.1,
      f2=0.25,
      sigma1sq=0.0035,
      sigma2sq=0.007,
      d2=3340,
      ERP=0.108,
      d0=-944.8,
      MDP=-74.65,
      VT=25.05,
      VR=41.25,
      Vh=-25,
      hr=0.1,
      hs=35,
      s=4,
      j=2,
      m=1,
      h=0,
      f=0,
      r=0.5),
    cfg_M=struct(
      ax0=-8.7,
      ay0=-190.9,
      az0=-190.4,
      ax1=-23.6,
      ay1=-45.5,
      az1=-12.9,
      ax2=-6.9,
      ay2=75.9,
      az2=6826.5,
      ax3=-33.2,
      ay3=14.36,
      az3=2,
      bx1=777.2,
      by1=58.9,
      bz1=276.6,
      VR=30,
      VT=44.5,
      VO=131.1,
      a=0.29,
      b=62.89,
      c=0.7,
      d=10.99,
      e=0.04)),
  RV_mm=struct(
    ax0=-8.7,
    ay0=-190.9,
    az0=-190.4,
    ax1=-23.6,
    ay1=-45.5,
    az1=-12.9,
    ax2=-6.9,
    ay2=75.9,
    az2=6826.5,
    ax3=-17.80971,
    ay3=13.97137,
    az3=1.783211,
    bx1=777.2,
    by1=58.9,
    bz1=276.6,
    VR=30,
    VT=44.5,
    VO=122.8702,
    a=0.29,
    b=62.89,
    c=0.7,
    d=10.99,
    e=0.04),
  RVm=struct(
    ax0=-8.7,
    ay0=-190.9,
    az0=-190.4,
    ax1=-23.6,
    ay1=-45.5,
    az1=-12.9,
    ax2=-6.9,
    ay2=75.9,
    az2=6826.5,
    ax3=-17.80971,
    ay3=13.97137,
    az3=1.783211,
    bx1=777.2,
    by1=58.9,
    bz1=276.6,
    VR=30,
    VT=44.5,
    VO=122.8702,
    a=0.29,
    b=62.89,
    c=0.7,
    d=10.99,
    e=0.04),
  LV_mm=struct(
    ax0=-8.7,
    ay0=-190.9,
    az0=-190.4,
    ax1=-23.6,
    ay1=-45.5,
    az1=-12.9,
    ax2=-6.9,
    ay2=75.9,
    az2=6826.5,
    ax3=-17.80971,
    ay3=13.97137,
    az3=1.783211,
    bx1=777.2,
    by1=58.9,
    bz1=276.6,
    VR=30,
    VT=44.5,
    VO=122.8702,
    a=0.29,
    b=62.89,
    c=0.7,
    d=10.99,
    e=0.04),
  LVm=struct(
    ax0=-8.7,
    ay0=-190.9,
    az0=-190.4,
    ax1=-23.6,
    ay1=-45.5,
    az1=-12.9,
    ax2=-6.9,
    ay2=75.9,
    az2=6826.5,
    ax3=-17.80971,
    ay3=13.97137,
    az3=1.783211,
    bx1=777.2,
    by1=58.9,
    bz1=276.6,
    VR=30,
    VT=44.5,
    VO=122.8702,
    a=0.29,
    b=62.89,
    c=0.7,
    d=10.99,
    e=0.04),
  path_1=struct(CVi2j=57, Dij=1, aij=0.01, bij=3.5, cij=0, CVj2i=57, Dji=1, aji=0.3, bji=62.89, cji=10.99, l=4.014003),
  path_2=struct(CVi2j=40, Dij=1, aij=0.01, bij=3.5, cij=0, CVj2i=40, Dji=1, aji=0.3, bji=62.89, cji=10.99, l=3.2),
  path_3=struct(CVi2j=50, Dij=1, aij=0.01, bij=3.5, cij=0, CVj2i=50, Dji=1, aji=0.3, bji=62.89, cji=10.99, l=3.509074),
  path_4=struct(CVi2j=80, Dij=1, aij=0.01, bij=3.5, cij=0, CVj2i=80, Dji=1, aji=0.3, bji=62.89, cji=10.99, l=4.548758),
  path_5=struct(
    CVi2j=1000,
    Dij=1,
    aij=0.3,
    bij=62.89,
    cij=10.99,
    CVj2i=1000,
    Dji=1,
    aji=0.3,
    bji=62.89,
    cji=10.99,
    l=1.698692),
  path_6=struct(
    CVi2j=1400,
    Dij=1,
    aij=0.3,
    bij=62.89,
    cij=10.99,
    CVj2i=1400,
    Dji=1,
    aji=0.3,
    bji=62.89,
    cji=10.99,
    l=44.15404),
  path_7=struct(
    CVi2j=1000,
    Dij=1,
    aij=0.3,
    bij=62.89,
    cij=10.99,
    CVj2i=1000,
    Dji=1,
    aji=0.3,
    bji=62.89,
    cji=10.99,
    l=2.682089),
  path_8=struct(
    CVi2j=700,
    Dij=1,
    aij=0.3,
    bij=62.89,
    cij=10.99,
    CVj2i=1000,
    Dji=1,
    aji=0.3,
    bji=62.89,
    cji=10.99,
    l=12.8),
  path_9=struct(
    CVi2j=1000,
    Dij=1,
    aij=0.3,
    bij=62.89,
    cij=10.99,
    CVj2i=1000,
    Dji=1,
    aji=0.3,
    bji=62.89,
    cji=10.99,
    l=4.531843),
  path_10=struct(
    CVi2j=1300,
    Dij=1,
    aij=0.3,
    bij=62.89,
    cij=10.99,
    CVj2i=1300,
    Dji=0.1,
    aji=0.3,
    bji=62.89,
    cji=10.99,
    l=14.0363),
  path_11=struct(
    CVi2j=1200,
    Dij=1,
    aij=0.3,
    bij=62.89,
    cij=10.99,
    CVj2i=1200,
    Dji=1,
    aji=0.3,
    bji=62.89,
    cji=10.99,
    l=18.19503),
  path_12=struct(
    CVi2j=600,
    Dij=1,
    aij=0.3,
    bij=62.89,
    cij=10.99,
    CVj2i=600,
    Dji=1,
    aji=0.3,
    bji=62.89,
    cji=10.99,
    l=33.95998),
  path_13=struct(CVi2j=1300, Dij=1, aij=0.3, bij=62.89, cij=10.99, CVj2i=1300, Dji=2, aji=0.01, bji=3.5, cji=0, l=10),
  path_14=struct(
    CVi2j=1300,
    Dij=1,
    aij=0.3,
    bij=62.89,
    cij=10.99,
    CVj2i=1300,
    Dji=1,
    aji=0.3,
    bji=62.89,
    cji=10.99,
    l=8.0399),
  path_15=struct(CVi2j=70, Dij=2, aij=0.01, bij=3.5, cij=0, CVj2i=70, Dji=1, aji=0.3, bji=62.89, cji=10.99, l=12.00666),
  path_16=struct(
    CVi2j=1000,
    Dij=1,
    aij=0.3,
    bij=62.89,
    cij=10.99,
    CVj2i=1000,
    Dji=1,
    aji=0.3,
    bji=62.89,
    cji=10.99,
    l=7.694154),
  path_17=struct(
    CVi2j=1200,
    Dij=1,
    aij=0.3,
    bij=62.89,
    cij=10.99,
    CVj2i=1200,
    Dji=2,
    aji=0.07,
    bji=1.5,
    cji=0,
    l=5.215362),
  path_18=struct(CVi2j=69, Dij=2, aij=0.01, bij=2, cij=0, CVj2i=70, Dji=1, aji=0.3, bji=62.89, cji=10.99, l=5.656854),
  path_19=struct(
    CVi2j=700,
    Dij=1,
    aij=0.3,
    bij=62.89,
    cij=10.99,
    CVj2i=500,
    Dji=1,
    aji=0.3,
    bji=62.89,
    cji=10.99,
    l=13.88524),
  path_20=struct(
    CVi2j=1300,
    Dij=1,
    aij=0.3,
    bij=62.89,
    cij=10.99,
    CVj2i=1300,
    Dji=1,
    aji=0.3,
    bji=62.89,
    cji=10.99,
    l=47.03871),
  path_21=struct(
    CVi2j=800,
    Dij=1,
    aij=0.3,
    bij=62.89,
    cij=10.99,
    CVj2i=800,
    Dji=1,
    aji=0.3,
    bji=62.89,
    cji=10.99,
    l=27.27343),
  path_22=struct(
    CVi2j=700,
    Dij=1,
    aij=0.3,
    bij=62.89,
    cij=10.99,
    CVj2i=700,
    Dji=1,
    aji=0.3,
    bji=62.89,
    cji=10.99,
    l=13.86218),
  path_23=struct(
    CVi2j=3400,
    Dij=1,
    aij=0.3,
    bij=62.89,
    cij=10.99,
    CVj2i=3400,
    Dji=1,
    aji=0.3,
    bji=62.89,
    cji=10.99,
    l=18.67619),
  path_24=struct(
    CVi2j=3400,
    Dij=1,
    aij=0.3,
    bij=62.89,
    cij=10.99,
    CVj2i=3400,
    Dji=1,
    aji=0.3,
    bji=62.89,
    cji=10.99,
    l=12.82498),
  path_25=struct(
    CVi2j=3400,
    Dij=1,
    aij=0.3,
    bij=62.89,
    cij=10.99,
    CVj2i=3400,
    Dji=1,
    aji=0.3,
    bji=62.89,
    cji=10.99,
    l=15.87955),
  path_26=struct(
    CVi2j=3200,
    Dij=1,
    aij=0.3,
    bij=62.89,
    cij=10.99,
    CVj2i=3200,
    Dji=1,
    aji=0.3,
    bji=62.89,
    cji=10.99,
    l=28.96895),
  path_27=struct(
    CVi2j=3200,
    Dij=1,
    aij=0.3,
    bij=62.89,
    cij=10.99,
    CVj2i=3200,
    Dji=1,
    aji=0.3,
    bji=62.89,
    cji=10.99,
    l=29.80738),
  path_28=struct(
    CVi2j=3200,
    Dij=1,
    aij=0.3,
    bij=62.89,
    cij=10.99,
    CVj2i=3200,
    Dji=1,
    aji=0.3,
    bji=62.89,
    cji=10.99,
    l=34.03528),
  path_29=struct(
    CVi2j=3200,
    Dij=1,
    aij=0.3,
    bij=62.89,
    cij=10.99,
    CVj2i=3200,
    Dji=1,
    aji=0.3,
    bji=62.89,
    cji=10.99,
    l=7.375636),
  path_30=struct(
    CVi2j=1000,
    Dij=1,
    aij=0.3,
    bij=62.89,
    cij=10.99,
    CVj2i=4000,
    Dji=1,
    aji=0.3,
    bji=62.89,
    cji=10.99,
    l=3.687818),
  path_31=struct(
    CVi2j=2000,
    Dij=1,
    aij=0.3,
    bij=62.89,
    cij=10.99,
    CVj2i=2000,
    Dji=1,
    aji=0.3,
    bji=62.89,
    cji=10.99,
    l=46.10423),
  path_32=struct(
    CVi2j=3200,
    Dij=1,
    aij=0.3,
    bij=62.89,
    cij=10.99,
    CVj2i=3200,
    Dji=1,
    aji=0.3,
    bji=62.89,
    cji=10.99,
    l=30.61503),
  path_33=struct(
    CVi2j=1000,
    Dij=1,
    aij=0.3,
    bij=62.89,
    cij=10.99,
    CVj2i=4000,
    Dji=1,
    aji=0.3,
    bji=62.89,
    cji=10.99,
    l=7.515318),
  path_34=struct(
    CVi2j=3200,
    Dij=1,
    aij=0.3,
    bij=62.89,
    cij=10.99,
    CVj2i=3200,
    Dji=1,
    aji=0.3,
    bji=62.89,
    cji=10.99,
    l=7.472617),
  path_35=struct(
    CVi2j=1000,
    Dij=1,
    aij=0.3,
    bij=62.89,
    cij=10.99,
    CVj2i=4200,
    Dji=1,
    aji=0.3,
    bji=62.89,
    cji=10.99,
    l=3.736308),
  path_36=struct(
    CVi2j=2000,
    Dij=1,
    aij=0.3,
    bij=62.89,
    cij=10.99,
    CVj2i=2000,
    Dji=1,
    aji=0.3,
    bji=62.89,
    cji=10.99,
    l=36.71512),
  path_37=struct(
    CVi2j=434,
    Dij=1,
    aij=0.3,
    bij=62.89,
    cij=10.99,
    CVj2i=449,
    Dji=1,
    aji=0.3,
    bji=62.89,
    cji=10.99,
    l=16.1059),
  path_38=struct(
    CVi2j=1000,
    Dij=1,
    aij=0.3,
    bij=62.89,
    cij=10.99,
    CVj2i=1000,
    Dji=1,
    aji=0.3,
    bji=62.89,
    cji=10.99,
    l=48.73602),
  path_39=struct(
    CVi2j=1000,
    Dij=1,
    aij=0.3,
    bij=62.89,
    cij=10.99,
    CVj2i=1000,
    Dji=1,
    aji=0.3,
    bji=62.89,
    cji=10.99,
    l=48.83646),
  path_40=struct(
    CVi2j=1000,
    Dij=1,
    aij=0.3,
    bij=62.89,
    cij=10.99,
    CVj2i=1000,
    Dji=1,
    aji=0.3,
    bji=62.89,
    cji=10.99,
    l=41.41546),
  path_41=struct(
    CVi2j=1000,
    Dij=1,
    aij=0.3,
    bij=62.89,
    cij=10.99,
    CVj2i=1000,
    Dji=1,
    aji=0.3,
    bji=62.89,
    cji=10.99,
    l=37.78783),
  path_42=struct(
    CVi2j=1000,
    Dij=1,
    aij=0.3,
    bij=62.89,
    cij=10.99,
    CVj2i=1000,
    Dji=1,
    aji=0.3,
    bji=62.89,
    cji=10.99,
    l=44.68915),
  path_43=struct(
    CVi2j=434,
    Dij=1,
    aij=0.3,
    bij=62.89,
    cij=10.99,
    CVj2i=449,
    Dji=1,
    aji=0.3,
    bji=62.89,
    cji=10.99,
    l=22.91201),
  path_44=struct(
    CVi2j=434,
    Dij=1,
    aij=0.3,
    bij=62.89,
    cij=10.99,
    CVj2i=449,
    Dji=1,
    aji=0.3,
    bji=62.89,
    cji=10.99,
    l=23.44014),
  path_45=struct(
    CVi2j=2000,
    Dij=1,
    aij=0.3,
    bij=62.89,
    cij=10.99,
    CVj2i=2000,
    Dji=1,
    aji=0.3,
    bji=62.89,
    cji=10.99,
    l=42.42641),
  path_46=struct(
    CVi2j=1000,
    Dij=1,
    aij=0.3,
    bij=62.89,
    cij=10.99,
    CVj2i=2000,
    Dji=1,
    aji=0.3,
    bji=62.89,
    cji=10.99,
    l=5),
  path_47=struct(
    CVi2j=1000,
    Dij=1,
    aij=0.3,
    bij=62.89,
    cij=10.99,
    CVj2i=2000,
    Dji=1,
    aji=0.3,
    bji=62.89,
    cji=10.99,
    l=8),
  path_48=struct(
    CVi2j=1000,
    Dij=1,
    aij=0.3,
    bij=62.89,
    cij=10.99,
    CVj2i=1000,
    Dji=1,
    aji=0.3,
    bji=62.89,
    cji=10.99,
    l=31.42738),
  path_49=struct(
    CVi2j=1000,
    Dij=1,
    aij=0.3,
    bij=62.89,
    cij=10.99,
    CVj2i=1000,
    Dji=1,
    aji=0.3,
    bji=62.89,
    cji=10.99,
    l=41.57884),
  path_50=struct(
    CVi2j=2000,
    Dij=1,
    aij=0.3,
    bij=62.89,
    cij=10.99,
    CVj2i=2000,
    Dji=1,
    aji=0.3,
    bji=62.89,
    cji=10.99,
    l=31.55693),
  path_51=struct(
    CVi2j=1000,
    Dij=1,
    aij=0.3,
    bij=62.89,
    cij=10.99,
    CVj2i=2000,
    Dji=1,
    aji=0.3,
    bji=62.89,
    cji=10.99,
    l=3),
  path_52=struct(
    CVi2j=1000,
    Dij=1,
    aij=0.3,
    bij=62.89,
    cij=10.99,
    CVj2i=2000,
    Dji=1,
    aji=0.3,
    bji=62.89,
    cji=10.99,
    l=3),
  path_53=struct(
    CVi2j=1000,
    Dij=1,
    aij=0.3,
    bij=62.89,
    cij=10.99,
    CVj2i=1000,
    Dji=1,
    aji=0.3,
    bji=62.89,
    cji=10.99,
    l=51.84785),
  path_54=struct(
    CVi2j=1000,
    Dij=1,
    aij=0.3,
    bij=62.89,
    cij=10.99,
    CVj2i=1000,
    Dji=1,
    aji=0.3,
    bji=62.89,
    cji=10.99,
    l=31.55693),
  dipole_1=struct(xi=54.2, yi=118.2, zi=0, xj=57.86667, yj=119.8333, zj=0, C=1),
  dipole_2=struct(xi=54.2, yi=118.2, zi=0, xj=57.4, yj=118.2, zj=0, C=1),
  dipole_3=struct(xi=54.2, yi=118.2, zi=0, xj=56.6, yj=115.64, zj=0, C=1),
  dipole_4=struct(xi=54.2, yi=118.2, zi=0, xj=52.36, yj=114.04, zj=0, C=1),
  dipole_5=struct(xi=57.86667, yi=119.8333, zi=0, xj=57.4, yj=118.2, zj=0, C=23),
  dipole_6=struct(xi=57.86667, yi=119.8333, zi=0, xj=98.2, yj=137.8, zj=0, C=23),
  dipole_7=struct(xi=57.4, yi=118.2, zi=0, xj=56.6, yj=115.64, zj=0, C=23),
  dipole_8=struct(xi=57.4, yi=118.2, zi=0, xj=70.2, yj=118.2, zj=0, C=23),
  dipole_9=struct(xi=56.6, yi=115.64, zi=0, xj=52.36, yj=114.04, zj=0, C=23),
  dipole_10=struct(xi=56.6, yi=115.64, zi=0, xj=66.2, yj=105.4, zj=0, C=23),
  dipole_11=struct(xi=52.36, yi=114.04, zi=0, xj=45, yj=97.4, zj=0, C=23),
  dipole_12=struct(xi=45, yi=97.4, zi=0, xj=53.8, yj=64.6, zj=0, C=23),
  dipole_13=struct(xi=66.2, yi=105.4, zi=0, xj=60.2, yj=97.4, zj=0, C=23),
  dipole_14=struct(xi=66.2, yi=105.4, zi=0, xj=67, yj=97.4, zj=0, C=23),
  dipole_15=struct(xi=60.2, yi=97.4, zi=0, xj=60.6, yj=85.4, zj=0, C=23),
  dipole_16=struct(xi=60.6, yi=85.4, zi=0, xj=68.2, yj=86.6, zj=0, C=23),
  dipole_17=struct(xi=67, yi=97.4, zi=0, xj=67.4, yj=92.2, zj=0, C=23),
  dipole_18=struct(xi=67.4, yi=92.2, zi=0, xj=68.2, yj=86.6, zj=0, C=23),
  dipole_19=struct(xi=70.2, yi=118.2, zi=0, xj=79.4, yj=107.8, zj=0, C=23),
  dipole_20=struct(xi=79.4, yi=107.8, zi=0, xj=118.6, yj=133.8, zj=0, C=23),
  dipole_21=struct(xi=98.2, yi=137.8, zi=0, xj=125.4, yj=139.8, zj=0, C=23),
  dipole_22=struct(xi=125.4, yi=139.8, zi=0, xj=135.4, yj=130.2, zj=0, C=23),
  dipole_23=struct(xi=68.2, yi=86.6, zi=0, xj=81.8, yj=99.4, zj=0, C=2),
  dipole_24=struct(xi=81.8, yi=99.4, zi=0, xj=94.6, yj=100.2, zj=0, C=2),
  dipole_25=struct(xi=94.6, yi=100.2, zi=0, xj=105, yj=88.2, zj=0, C=2),
  dipole_26=struct(xi=105, yi=88.2, zi=0, xj=121.8, yj=64.6, zj=0, C=23),
  dipole_27=struct(xi=105, yi=88.2, zi=0, xj=127.8, yj=69, zj=0, C=23),
  dipole_28=struct(xi=121.8, yi=64.6, zi=0, xj=153, yj=51, zj=0, C=23),
  dipole_29=struct(xi=153, yi=51, zi=0, xj=157.8, yj=45.4, zj=0, C=23),
  dipole_30=struct(xi=157.8, yi=45.4, zi=0, xj=160.2, yj=42.6, zj=0, C=50),
  dipole_31=struct(xi=157.8, yi=45.4, zi=0, xj=112.2, yj=38.6, zj=0, C=23),
  dipole_32=struct(xi=127.8, yi=69, zi=0, xj=157, yj=59.8, zj=0, C=23),
  dipole_33=struct(xi=127.8, yi=69, zi=0, xj=131, yj=75.8, zj=0, C=50),
  dipole_34=struct(xi=157, yi=59.8, zi=0, xj=164.2, yj=57.8, zj=0, C=23),
  dipole_35=struct(xi=164.2, yi=57.8, zi=0, xj=167.8, yj=56.8, zj=0, C=50),
  dipole_36=struct(xi=164.2, yi=57.8, zi=0, xj=159.4, yj=94.2, zj=0, C=23),
  dipole_37=struct(xi=160.2, yi=42.6, zi=0, xj=167.8, yj=56.8, zj=0, C=50),
  dipole_38=struct(xi=160.2, yi=42.6, zi=0, xj=114.6, yj=59.8, zj=0, C=50),
  dipole_39=struct(xi=160.2, yi=42.6, zi=0, xj=112.2, yj=33.6, zj=0, C=50),
  dipole_40=struct(xi=167.8, yi=56.8, zi=0, xj=131, yj=75.8, zj=0, C=50),
  dipole_41=struct(xi=167.8, yi=56.8, zi=0, xj=162.4, yj=94.2, zj=0, C=50),
  dipole_42=struct(xi=114.6, yi=59.8, zi=0, xj=83, yj=91.4, zj=0, C=50),
  dipole_43=struct(xi=114.6, yi=59.8, zi=0, xj=131, yj=75.8, zj=0, C=50),
  dipole_44=struct(xi=83, yi=91.4, zi=0, xj=101.8, yj=105.4, zj=0, C=50),
  dipole_45=struct(xi=112.2, yi=38.6, zi=0, xj=75, yj=59, zj=0, C=23),
  dipole_46=struct(xi=112.2, yi=38.6, zi=0, xj=112.2, yj=33.6, zj=0, C=23),
  dipole_47=struct(xi=75, yi=59, zi=0, xj=67, yj=59, zj=0, C=23),
  dipole_48=struct(xi=101.8, yi=105.4, zi=0, xj=125, yj=126.6, zj=0, C=50),
  dipole_49=struct(xi=131, yi=75.8, zi=0, xj=101.8, yj=105.4, zj=0, C=50),
  dipole_50=struct(xi=159.4, yi=94.2, zi=0, xj=143.4, yj=121.4, zj=0, C=23),
  dipole_51=struct(xi=159.4, yi=94.2, zi=0, xj=162.4, yj=94.2, zj=0, C=23),
  dipole_52=struct(xi=143.4, yi=121.4, zi=0, xj=146.4, yj=121.4, zj=0, C=23),
  dipole_53=struct(xi=112.2, yi=33.6, zi=0, xj=67, yj=59, zj=0, C=50),
  dipole_54=struct(xi=162.4, yi=94.2, zi=0, xj=146.4, yj=121.4, zj=0, C=50))