% Simulink data dictionary Leads3D_Full.sldd
% references Leads_type.sldd

Lead_group = Simulink.Bus()
  lead_1: Bus: Lead
  lead_2: Bus: Lead
  lead_3: Bus: Lead
  lead_4: Bus: Lead
  lead_5: Bus: Lead
  lead_6: Bus: Lead
  lead_7: Bus: Lead
  lead_8: Bus: Lead

Leads = struct(
  lead_1=struct(e_pos=struct(x=95.63, y=49.13, z=74.13), e_type=int8(1)),
  lead_2=struct(e_pos=struct(x=93.63, y=51.13, z=72.13), e_type=int8(1)),
  lead_3=struct(e_pos=struct(x=86.63, y=57.13, z=67.13), e_type=int8(2)),
  lead_4=struct(e_pos=struct(x=84.63, y=58.13, z=65.13), e_type=int8(2)),
  lead_5=struct(e_pos=struct(x=132.24, y=85.41, z=34.9), e_type=int8(3)),
  lead_6=struct(e_pos=struct(x=133.25, y=83.41, z=33.89), e_type=int8(3)),
  lead_7=struct(e_pos=struct(x=130.38, y=95.88, z=40.13), e_type=int8(4)),
  lead_8=struct(e_pos=struct(x=131.38, y=93.88, z=39.13), e_type=int8(4)))