% Simulink data dictionary Leads_3D.sldd
% references Leads_type.sldd

Lead_group = Simulink.Bus()
  lead_1: Bus: Lead
  lead_2: Bus: Lead
  lead_3: Bus: Lead
  lead_4: Bus: Lead
  lead_5: Bus: Lead
  lead_6: Bus: Lead
  lead_7: Bus: Lead
  lead_8: Bus: Lead

Leads = struct(
  lead_1=struct(e_pos=struct(x=77.02211, y=102.7455, z=1), e_type=int8(1)),
  lead_2=struct(e_pos=struct(x=75.55625, y=106.4673, z=1), e_type=int8(1)),
  lead_3=struct(e_pos=struct(x=72.25808, y=114.8411, z=2), e_type=int8(2)),
  lead_4=struct(e_pos=struct(x=71.52515, y=116.702, z=2), e_type=int8(2)),
  lead_5=struct(e_pos=struct(x=146.149, y=52.1575, z=1), e_type=int8(3)),
  lead_6=struct(e_pos=struct(x=149.4332, y=49.87396, z=1), e_type=int8(3)),
  lead_7=struct(e_pos=struct(x=156.8225, y=44.73599, z=3), e_type=int8(4)),
  lead_8=struct(e_pos=struct(x=158.4646, y=43.59422, z=3), e_type=int8(4)))