% Simulink data dictionary pathExample.sldd
% references N_dd.sldd
% references M_dd.sldd
% references Path_dd.sldd

cfg_P = struct(CVi2j=57, Dij=1, aij=0.01, bij=3.5, cij=0, CVj2i=57, Dji=1, aji=0.3, bji=62.89, cji=10.99, l=10)

cfg_N = struct(
  BCL=0.814,
  SD=0.002,
  f1=0.1,
  f2=0.25,
  sigma1sq=0.0035,
  sigma2sq=0.007,
  d2=1281,
  ERP=0.1615,
  d0=-773.2,
  MDP=-85.3,
  VT=23.81,
  VR=47.94,
  Vh=-4,
  hr=0.1,
  hs=35,
  s=5,
  j=0,
  m=1,
  h=0.2,
  f=0.1,
  r=0.5)

cfg_M = struct(
  ax0=-8.7,
  ay0=-190.9,
  az0=-190.4,
  ax1=-23.6,
  ay1=-45.5,
  az1=-12.9,
  ax2=-6.9,
  ay2=75.9,
  az2=6826.5,
  ax3=-17.809705,
  ay3=13.971374,
  az3=1.783211,
  bx1=777.2,
  by1=58.9,
  bz1=276.6,
  VR=30,
  VT=44.5,
  VO=122.870185,
  a=0.29,
  b=62.89,
  c=0.7,
  d=10.99,
  e=0.04)