% Simulink data dictionary M_dd.sldd
% references cell_out_type.sldd
% references M_cfg_type.sldd

cell = Simulink.Signal(DataType="Bus: Cell")
cfg = Simulink.Signal(InitialValue="cfg_default", StorageClass="ExportedGlobal", DataType="Bus: Config")

cfg_default = Simulink.Parameter(struct(
  ax0=-8.7,
  ay0=-190.9,
  az0=-190.4,
  ax1=-23.6,
  ay1=-45.5,
  az1=-12.9,
  ax2=-6.9,
  ay2=75.9,
  az2=6826.5,
  ax3=-17.809705,
  ay3=13.971374,
  az3=1.783211,
  bx1=777.2,
  by1=58.9,
  bz1=276.6,
  VR=30,
  VT=44.5,
  VO=122.870185,
  a=0.29,
  b=62.89,
  c=0.7,
  d=10.99,
  e=0.04), DataType="Bus: Config")