% Simulink data dictionary NM_dd.sldd
% references cell_out_type.sldd
% references NM_cfg_type.sldd
% references P_cfg_type.sldd
% references Path2Probe_type.sldd

zero_path_cfg = Simulink.Parameter(struct(CVi2j=1, Dij=1, aij=1, bij=0, cij=0, CVj2i=1, Dji=1, aji=1, bji=0, cji=0), DataType="Bus: Config_Path")
Bus_N = Simulink.Signal(InitialValue="cfg_default_N", StorageClass="ExportedGlobal", DataType="Bus: Config_N")
Bus_M = Simulink.Signal(InitialValue="cfg_default_M", StorageClass="ExportedGlobal", DataType="Bus: Config_M")

cfg_default_N = Simulink.Parameter(struct(
  BCL=0.814,
  SD=0.002,
  f1=0.1,
  f2=0.25,
  sigma1sq=0.0035,
  sigma2sq=0.007,
  d2=1281,
  ERP=0.1615,
  d0=-773.2,
  MDP=-85.3,
  VT=23.81,
  VR=47.94,
  Vh=-4,
  hr=0.1,
  hs=35,
  s=5,
  j=0,
  m=1,
  h=0.2,
  f=0.1,
  r=0.5), StorageClass="ExportedGlobal", DataType="Bus: Config_N")

cfg_default_M = Simulink.Parameter(struct(
  ax0=-8.7,
  ay0=-190.9,
  az0=-190.4,
  ax1=-23.6,
  ay1=-45.5,
  az1=-12.9,
  ax2=-6.9,
  ay2=75.9,
  az2=6826.5,
  ax3=-17.809705,
  ay3=13.971374,
  az3=1.783211,
  bx1=777.2,
  by1=58.9,
  bz1=276.6,
  VR=30,
  VT=44.5,
  VO=122.870185,
  a=0.29,
  b=62.89,
  c=0.7,
  d=10.99,
  e=0.04), StorageClass="ExportedGlobal", DataType="Bus: Config_M")

cfg_nm = Simulink.Signal(InitialValue="cfg_default_nm", StorageClass="ExportedGlobal", DataType="Bus: Config_NM")

cfg_default_nm = Simulink.Parameter(struct(
  Bus_N=struct(
    BCL=0.814,
    SD=0.002,
    f1=0.1,
    f2=0.25,
    sigma1sq=0.0035,
    sigma2sq=0.007,
    d2=1281,
    ERP=0.1615,
    d0=-773.2,
    MDP=-85.3,
    VT=23.81,
    VR=47.94,
    Vh=-4,
    hr=0.1,
    hs=35,
    s=5,
    j=0,
    m=1,
    h=0.2,
    f=0.1,
    r=0.5),
  Bus_M=struct(
    ax0=-8.7,
    ay0=-190.9,
    az0=-190.4,
    ax1=-23.6,
    ay1=-45.5,
    az1=-12.9,
    ax2=-6.9,
    ay2=75.9,
    az2=6826.5,
    ax3=-17.809705,
    ay3=13.971374,
    az3=1.783211,
    bx1=777.2,
    by1=58.9,
    bz1=276.6,
    VR=30,
    VT=44.5,
    VO=122.870185,
    a=0.29,
    b=62.89,
    c=0.7,
    d=10.99,
    e=0.04)), StorageClass="ExportedGlobal", DataType="Bus: Config_NM")