% Simulink data dictionary N_dd.sldd
% references N_cfg_type.sldd
% references cell_out_type.sldd

cell = Simulink.Signal(DataType="Bus: Cell")

cfg_default = Simulink.Parameter(struct(
  BCL=0.814,
  SD=0.002,
  f1=0.1,
  f2=0.25,
  sigma1sq=0.0035,
  sigma2sq=0.007,
  d2=1281,
  ERP=0.1615,
  d0=-773.2,
  MDP=-85.3,
  VT=23.81,
  VR=47.94,
  Vh=-4,
  hr=0.1,
  hs=35,
  s=5,
  j=0,
  m=1,
  h=0.2,
  f=0.1,
  r=0.5), DataType="Bus: Config")

cfg = Simulink.Signal(InitialValue="cfg_default", StorageClass="ExportedGlobal", DataType="Bus: Config")