% Simulink data dictionary Path_dd.sldd
% references cell_out_type.sldd
% references P_cfg_type.sldd
% references Path2Probe_type.sldd

cfg = Simulink.Signal(DataType="Bus: Config")
celli = Simulink.Signal(DataType="Bus: Cell")
cellj = Simulink.Signal(DataType="Bus: Cell")
p_act = Simulink.Signal(DataType="Bus: Activation")
xi = Simulink.Parameter(57.8, DataType="double")
yi = Simulink.Parameter(119.8, DataType="double")
zi = Simulink.Parameter(0, DataType="double")
xj = Simulink.Parameter(56.5, DataType="double")
yj = Simulink.Parameter(118, DataType="double")
zj = Simulink.Parameter(0, DataType="double")
cfg_default = Simulink.Parameter(struct(CVi2j=57, Dij=1, aij=0.01, bij=3.5, cij=0, CVj2i=57, Dji=1, aji=0.3, bji=62.89, cji=10.99), DataType="Bus: Config")